# Dynamo graph FloorPlansByScopeBox_Pt2.dyn (Dynamo 2.16.2.5624)
# packages: Clockwork for Dynamo 2.x 2.12.2

# group: Get all Levels
code_block = CodeBlock { "Levels"; }
byName = Category.ByName(name=code_block)
all_elements_of_category = ElementsOfCategory(Category=byName)
watch = Watch(all_elements_of_category)
name = Level.Name(level=watch)

# group: Get all Scope Boxes
# - Gathers all Scope Boxes using 'All Elements of Category' with 'Category.ByName' of "Scope Boxes"
# - Extract names of scope boxes with 'Element.GetParameterValueByName" then sort the lilst by key.
# - List of scope box elements to be used to set scope box parameter for views created downstream and applied at the end.
# - Keys will be further processed for view names to have the proper scope box prefix for each view name.
code_block_2 = CodeBlock { "Scope Boxes"; }
byName_2 = Category.ByName(name=code_block_2)
all_elements_of_category_2 = ElementsOfCategory(Category=byName_2)
code_block_3 = CodeBlock { "Name"; }
getParameterValueByName = Element.GetParameterValueByName(element=all_elements_of_category_2, parameterName=code_block_3)
sortByKey = List.SortByKey(list=all_elements_of_category_2, keys=getParameterValueByName)
watch_2 = Watch(sortByKey.sortedKeys)
watch_3 = Watch(sortByKey.sortedList)

# group: ***EDIT*** Python node
# - Loops through each scope box in the list and formats the string for use as suffix in view names.
formatScopeList = Python(IN[0]=watch_2)  # CPython3
# ---------- formatScopeList.python (26 lines) ----------
# Load the Python Standard and DesignScript Libraries
import sys
import clr
clr.AddReference('ProtoGeometry')
from Autodesk.DesignScript.Geometry import *

# The inputs to this node will be stored as a list in the IN variables.
dataEnteringNode = IN

# Place your code below this line
scope_list = []

print(f"data entering: {dataEnteringNode[0]}")
for scope in IN[0]:
# Comment out with (#) depending on prefix or suffix

# Method for Prefix
    #scope_list.append(f"{scope} - ")
    
# Method for Suffix
    scope_list.append(f" - {scope}")

print(scope_list)

# Assign your output to the OUT variable.
OUT = scope_list
# ----------------------------------------

# group: Concatenante Level Names with Scope Box Names
watch_4 = Watch(name)
add = watch_4 + formatScopeList  # lacing=CrossProduct
watch_5 = Watch(add)

# group: Create Parent Views by Level & Dependent Views by Scope Boxes
byLevel = FloorPlanView.ByLevel(level=all_elements_of_category)
code_block_4 = CodeBlock { "View Name"; }
setParameterByName = Element.SetParameterByName(element=byLevel, parameterName=code_block_4, value=name)
watch_6 = Watch(setParameterByName)
duplicateAsDependent = Custom[View.DuplicateAsDependent](view=byLevel, name=add)  # package Clockwork for Dynamo 2.x; Duplicates a given view as a dependent view
watch_7 = Watch(duplicateAsDependent)

# group: Set View Template to Parent View... passed down to Dependent Views
# Find index of desired view template from the Watch node and place inside Code Block_View Template Index
code_block_5 = CodeBlock { "Views"; }
byName_3 = Category.ByName(name=code_block_5)
all_elements_of_category_3 = ElementsOfCategory(Category=byName_3)
watch_8 = Watch(all_elements_of_category_3)
code_block_6 = CodeBlock { "View Template"; }
code_block_view_template_index = CodeBlock { 17; }
getItemAtIndex = List.GetItemAtIndex(list=all_elements_of_category_3, index=code_block_view_template_index)
watch_9 = Watch(getItemAtIndex)
setParameterByName_2 = Element.SetParameterByName(element=byLevel, parameterName=code_block_6, value=watch_9)

# group: Set Scope Boxes to corresponding VIews
code_block_7 = CodeBlock { "Scope Box"; }
setParameterByName_3 = Element.SetParameterByName(element=watch_7, parameterName=code_block_7, value=sortByKey.sortedList@L2, lacing=Longest)

watch_10 = Watch(setParameterByName_3)
